# Dynamo graph Clash Detection.dyn "Dynamo Task 03_ Mohamed Assem Mohamed_65071121" (Dynamo 2.5.0.7460)
# packages: Rhythm 2022.7.2, bimorphNodes 3.0.3

family_types = FamilyTypes("Wall Opening:Wall Opening")

# group: Elements
links = Links("KT-BIM-R10-MECH MODEL.rvt : 2 : location <Not Shared>")
categories = Categories("OST_DuctCurves")
ofCategory = Revit.LinkElement.OfCategory(linkInstance=links, Category=categories)
categories_2 = Categories("OST_Walls")
all_elements_of_category = ElementsOfCategory(Category=categories_2)

# group: Interset
geometry = Element.Geometry(element=ofCategory)
geometry_2 = Element.Geometry(element=all_elements_of_category)
intersect = Geometry.Intersect(geometry=geometry, other=geometry_2, lacing=CrossProduct)

# group: Points
explode = Geometry.Explode(geometry=intersect)
code_block = CodeBlock { 0; 0.5; true; }
getItemAtIndex = List.GetItemAtIndex(list=explode@L2, index=code_block.out0)
pointAtParameter = Surface.PointAtParameter(surface=getItemAtIndex, u=code_block.out1, v=code_block.out1)

# group: Surfaces of Walls
intersectsElement = Revit.Element.IntersectsElement(elementSetA=ofCategory, elementSetB=all_elements_of_category)
faces = Element.Faces(element=intersectsElement.Element)
flatten = List.Flatten(list=faces)
byGeometry = BoundingBox.ByGeometry(geom=flatten@L1)
contains = BoundingBox.Contains(boundingBox=byGeometry, point=pointAtParameter, lacing=CrossProduct)
contains_2 = List.Contains(list=contains@L2, item=code_block.out2)
filterByBoolMask = List.FilterByBoolMask(list=flatten, mask=contains_2)

# group: Reference Direction For Surfaces
normalAtPoint = Surface.NormalAtPoint(surface=filterByBoolMask.in, point=pointAtParameter)
ZAxis = Vector.ZAxis()
code_block_2 = CodeBlock { 90; }
rotate = Vector.Rotate(vector=normalAtPoint, axis=ZAxis, degrees=code_block_2)

byFace = FamilyInstance.ByFace(familyType=family_types, face=filterByBoolMask.in, location=pointAtParameter, referenceDirection=rotate)

# group: Surfaces of Ducts
intersectsElement_2 = Revit.Element.IntersectsElement(elementSetA=all_elements_of_category, elementSetB=ofCategory)
faces_2 = Element.Faces(element=intersectsElement_2.Element)
flatten_2 = List.Flatten(list=faces_2)
byGeometry_2 = BoundingBox.ByGeometry(geom=flatten_2@L1)
contains_3 = BoundingBox.Contains(boundingBox=byGeometry_2, point=pointAtParameter, lacing=CrossProduct)
contains_4 = List.Contains(list=contains_3@L2, item=code_block.out2)
filterByBoolMask_2 = List.FilterByBoolMask(list=flatten_2, mask=contains_4)

# group: Get Depth of Ducts
code_block_3 = CodeBlock { "Width"; false; }
ʳʰʸᵗʰᵐ_elements = Rhythm.Revit.Elements.Elements.GetParameterValueByNameTypeOrInstance(element=filterByBoolMask.in, parameterName=code_block_3.out0)
clean = List.Clean(list=ʳʰʸᵗʰᵐ_elements, preserveIndices=code_block_3.out1)

# group: Get Width and Height of Ducts
ʳʰʸᵗʰᵐ_elements_2 = Rhythm.Revit.Elements.Elements.GetParameterValueByNameTypeOrInstance(element=filterByBoolMask_2.in, parameterName=code_block_3.out0)
clean_2 = List.Clean(list=ʳʰʸᵗʰᵐ_elements_2, preserveIndices=code_block_3.out1)
code_block_4 = CodeBlock { "Height"; false; }
ʳʰʸᵗʰᵐ_elements_3 = Rhythm.Revit.Elements.Elements.GetParameterValueByNameTypeOrInstance(element=filterByBoolMask_2.in, parameterName=code_block_4.out0)
clean_3 = List.Clean(list=ʳʰʸᵗʰᵐ_elements_3, preserveIndices=code_block_4.out1)
intersectsElement_3 = Revit.Element.IntersectsElement(elementSetA=all_elements_of_category, elementSetB=ofCategory)

# group: Automate Dimensions of Ducts
code_block_5 = CodeBlock { "Width"; "Height"; "Depth"; }
setParameterByName = Element.SetParameterByName(element=byFace, parameterName=code_block_5.out0, value=clean_2)
setParameterByName_2 = Element.SetParameterByName(element=byFace, parameterName=code_block_5.out1, value=clean_3)
setParameterByName_3 = Element.SetParameterByName(element=byFace, parameterName=code_block_5.out2, value=clean)
