# Dynamo graph Create Levels And Views.dyn "Dynamo Task 02_ Mohamed Assem Mohamed_65071121" (Dynamo 2.5.0.7460)
# packages: archi-lab.net 2024.217.1024

# group: Create Levels & Views
file_path = Filename("..\..\Task\Dynamo Content 02\KT-BIM-R10-Create Levels-Views.xlsx")
file_from_path = FileObject(path=file_path)
code_block = CodeBlock { "View Name and Elevation"; 0; "Duplicate"; 50; "Duplicates"; }
importExcel = Data.ImportExcel(file=file_from_path, sheetName=code_block.out0)
removeItemAtIndex = List.RemoveItemAtIndex(list=importExcel, indices=code_block.out1)
transpose = List.Transpose(lists=removeItemAtIndex)
code_block_2 = CodeBlock(L=transpose) { L[1]; L[0]; }
byElevationAndName = Level.ByElevationAndName(elevation=code_block_2.out0, name=code_block_2.out1)
byLevel = StructuralPlanView.ByLevel(level=byElevationAndName)
importExcel_2 = Data.ImportExcel(file=file_from_path, sheetName=code_block.out4, showExcel=code_block.out1)
removeItemAtIndex_2 = List.RemoveItemAtIndex(list=importExcel_2, indices=code_block.out1)
transpose_2 = List.Transpose(lists=removeItemAtIndex_2)
duplicate = archilab.Revit.Views.Views.Duplicate(view=byLevel@L2, name=transpose_2@L2, options=code_block.out2, lacing=Longest)
setScale = View.SetScale(view=byLevel, scale=code_block.out3)
