# Dynamo graph Renaming& Renumbering Grids.dyn "Dynamo Task 01_ Mohamed Assem Mohamed_65071121" (Dynamo 2.5.0.7460)

# group: Renaming HL & VL Grids
select_model_elements = DSModelElementsSelection()  # 14 picked in the model
select_model_elements_2 = DSModelElementsSelection()  # 11 picked in the model
code_block = CodeBlock { str1 = "Name"; t1 = Math.RandomList(10000); }
string_from_object = FromObject(obj=code_block.t1)
code_block_2 = CodeBlock(t1=select_model_elements_2, str7=code_block.str1, t5=string_from_object, t7=select_model_elements, str8=code_block_3.str1, t11=string_from_object_3)
# ---------- code_block_2.designscript (20 lines) ----------
str5 = "Horizontal Grids (letters)";
str6 = "Horizontal Grids(Numbers)";
curve1 = Grid.Curve(t1);
point1 = Curve.StartPoint(curve1);
num3 = Point.X(point1);
t2 = List.SortByKey(t1, num3);
t3 = Dictionary.ValueAtKey(t2, "sorted list");
t4 = Dictionary.ValueAtKey(t2, "sorted keys");
element1 = Element.SetParameterByName(t3, str7, t5);
str4 = "Name";
t6 = (1..1000..1);
curve2 = Grid.Curve(t7);
point2 = Curve.StartPoint(curve2);
num4 = Point.Y(point2);
t8 = List.SortByKey(t7, num4);
t9 = Dictionary.ValueAtKey(t8, "sorted list");
t10 = Dictionary.ValueAtKey(t8, "sorted keys");
element2 = Element.SetParameterByName(t9, str8, t11);
t12 = ("A".."Z"..1);
element3 = Element.SetParameterByName(element2, "Name", t12);
# ----------------------------------------
string_from_object_2 = FromObject(obj=code_block_2.t6)
code_block_3 = CodeBlock(element1=code_block_2.element1, str2=code_block_2.str4, t2=string_from_object_2) { str1 = "Name"; t1 = Math.RandomList(10000); element2 = Element.SetParameterByName(element1, str2, t2); }
string_from_object_3 = FromObject(obj=code_block_3.t1)
